# Grasshopper definition RainbowGrouping.gh (Grasshopper 1.0.7)
# plug-ins: ScriptParasite

c_script = CSharpScript(numberOfGroups=Slider(0, range=0..100))  # -> out; inputs numberOfGroups: Int32
# ---------- c_script: C# ----------
    UngroupghGroups(ghGroups, numberOfGroups);
# ---------- c_script: C# additional code ----------
  List<Grasshopper.Kernel.Special.GH_Group> ghGroups = new List<Grasshopper.Kernel.Special.GH_Group>();

  // Group Objects
  Grasshopper.Kernel.Special.GH_Group CreateghGroups(System.Guid guid, System.Drawing.Color colour, GH_Document doc)
  {
    Grasshopper.Kernel.Special.GH_Group ghGroup = new Grasshopper.Kernel.Special.GH_Group();
    ghGroup.Colour = colour;
    ghGroup.Name = "";
    ghGroup.NickName = "";
    GrasshopperDocument.AddObject(ghGroup, false, GrasshopperDocument.ObjectCount);
    ghGroup.AddObject(guid);
    ghGroup.ExpireCaches();
    ghGroups.Add(ghGroup);
    doc.ArrangeObject(ghGroup, GH_Arrange.MoveToBack);

    return ghGroup;
  }


  // Ungroup all groups previously made
  void UngroupghGroups(List<Grasshopper.Kernel.Special.GH_Group> ghGroups, int numberOfGroups)
  {
    GrasshopperDocument.ScheduleSolution(0, callback =>
      {
      for (int i = 0; i < ghGroups.Count; i++)
      {
        GrasshopperDocument.RemoveObject(ghGroups[i].Attributes, false);
        if (i >= ghGroups.Count)
        {
          ghGroups.Clear();
        }
      }

      GH_Document doc = this.GrasshopperDocument;
      Guid lastObject = this.Component.InstanceGuid;
      for (int i = 0; i < numberOfGroups; i++)
      {
        double hue = (double)i / (double)numberOfGroups;
        Grasshopper.Kernel.Special.GH_Group group = CreateghGroups(lastObject, HSL2RGB(hue, 1, 0.5), doc);
        lastObject = group.InstanceGuid;
      }

      });

  }

  //Modified from https://geekymonkey.com/Programming/CSharp/RGB2HSL_HSL2RGB.htm
  public static System.Drawing.Color HSL2RGB(double h, double sl, double l)
  {
    double v;
    double r, g, b;

    r = l;   // default to gray
    g = l;
    b = l;
    v = (l <= 0.5) ? (l * (1.0 + sl)) : (l + sl - l * sl);

    if (v > 0)

    {
      double m;
      double sv;
      int sextant;
      double fract, vsf, mid1, mid2;

      m = l + l - v;
      sv = (v - m) / v;
      h *= 6.0;
      sextant = (int)h;
      fract = h - sextant;
      vsf = v * sv * fract;
      mid1 = m + vsf;
      mid2 = v - vsf;
      switch (sextant)
      {
        case 0:
          r = v;
          g = mid1;
          b = m;
          break;
        case 1:
          r = mid2;
          g = v;
          b = m;
          break;
        case 2:
          r = m;
          g = v;
          b = mid1;
          break;
        case 3:
          r = m;
          g = mid2;
          b = v;
          break;
        case 4:
          r = mid1;
          g = m;
          b = v;
          break;
        case 5:
          r = v;
          g = m;
          b = mid2;
          break;
      }
    }
    int red = Convert.ToByte(r * 255);
    int green = Convert.ToByte(g * 255);
    int blue = Convert.ToByte(b * 255);

    System.Drawing.Color color = System.Drawing.Color.FromArgb(red, green, blue);

    return color;

  }
# ---------- end c_script ----------
script_parasite = ScriptParasite(Enable=True, Folder="C:\Users\ASUS\Desktop\Stupid Group Script")
